# Grasshopper definition 9_ML_Inference.ghx (Grasshopper 1.0.8)
# plug-ins: Eddy3D

list = ValueList({"AIJ case E": 0, "Wind Around Buildings": 1, "Validation Sample": 2}, selected="AIJ case E")
# How to?
# 
# -Please downlaod the ML models first (GAN and FNO).
#  Then assign them in the "File Path" components, respectively.
# 
# -Connect your input geometry to "Builidngs"
# 
# -Define wind speed/direction (optional).
# 
# -Define legend (optional).
select = SelectTemplate()

# ---- group: model selection
list_2 = ValueList({"GAN": 0, "GAN with TKE": 1, "GAN with TKE & Roof": 2}, selected="GAN")

# ----
brep = Brep([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])
brep_2 = Brep([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])
brep_3 = Brep([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])

# ---- group: Yel-1.0
yel_1_0 = CSharpScript(Run=True, Force=False)  # -> Status, FilePath, Progress; inputs Run: Boolean, Force: Boolean
# ---------- yel_1_0: C# ----------
// Grasshopper Script Instance
#region Usings
using System;
using System.IO;
using System.Diagnostics;
using System.Runtime.InteropServices;

using Rhino;
using Rhino.Geometry;

using Grasshopper;
using Grasshopper.Kernel;
using Grasshopper.Kernel.Data;
using Grasshopper.Kernel.Types;
#endregion

public class Script_Instance : GH_ScriptInstance
{
  private void RunScript(
		bool Run,
		bool Force,
		ref object Status,
		ref object FilePath,
		ref object Progress)
  {
    string modelUrl = "https://huggingface.co/SustainableUrbanSystemsLab/Yel/resolve/main/Yel.onnx";
    string modelFileName = "Yel.onnx";

    Progress = 0.0;

    try
    {
      if (!Run)
      {
        Status = "Set Run to True to download the model.";
        FilePath = null;
        Progress = 0.0;
        Component.Message = "Idle";
        return;
      }

      string userFolder = Environment.GetFolderPath(Environment.SpecialFolder.UserProfile);

      if (string.IsNullOrWhiteSpace(userFolder) || !Directory.Exists(userFolder))
      {
        Status = "Could not locate the user home folder.";
        FilePath = null;
        Progress = 0.0;
        Component.Message = "Error";
        return;
      }

      string modelFolder = Path.Combine(userFolder, "SUS_LAB");

      if (!Directory.Exists(modelFolder))
      {
        Directory.CreateDirectory(modelFolder);
      }

      string destinationPath = Path.Combine(modelFolder, modelFileName);
      string tempPath = destinationPath + ".download";

      FilePath = destinationPath;

      // Cache check
      if (File.Exists(destinationPath) && !Force)
      {
        FileInfo existingFile = new FileInfo(destinationPath);

        Status =
          "Model already exists. Using cached file.\n" +
          "Path: " + destinationPath + "\n" +
          "Size: " + Math.Round(existingFile.Length / 1024.0 / 1024.0, 2) + " MB\n" +
          "Set Force to True to re-download and replace it.";

        Progress = 100.0;
        Component.Message = "Cached";
        return;
      }

      if (File.Exists(tempPath))
      {
        File.Delete(tempPath);
      }

      Component.Message = "Downloading";
      Status = "Downloading model. Please wait...";

      bool isWindows = RuntimeInformation.IsOSPlatform(OSPlatform.Windows);
      bool isMac = RuntimeInformation.IsOSPlatform(OSPlatform.OSX);

      string curlPath = "";

      if (isWindows)
      {
        curlPath = "curl.exe";
      }
      else if (isMac)
      {
        curlPath = "/usr/bin/curl";
      }
      else
      {
        Status = "Unsupported operating system. This script currently supports Windows and macOS.";
        FilePath = null;
        Progress = 0.0;
        Component.Message = "Error";
        return;
      }

      ProcessStartInfo psi = new ProcessStartInfo();

      psi.FileName = curlPath;

      // -L follows Hugging Face redirects
      // --fail returns an error code for failed HTTP requests
      // --http1.1 avoids some HTTP/2 issues
      // --retry helps with unstable connections
      // --connect-timeout avoids hanging forever
      psi.Arguments =
        "-L --fail --show-error --http1.1 " +
        "--retry 3 --retry-delay 2 --connect-timeout 30 " +
        "-A \"Grasshopper-Yel-Model-Downloader\" " +
        "\"" + modelUrl + "\" " +
        "-o " +
        "\"" + tempPath + "\"";

      psi.UseShellExecute = false;
      psi.CreateNoWindow = true;
      psi.RedirectStandardOutput = true;
      psi.RedirectStandardError = true;

      using (Process process = new Process())
      {
        process.StartInfo = psi;
        process.Start();

        while (!process.HasExited)
        {
          if (File.Exists(tempPath))
          {
            FileInfo partialFile = new FileInfo(tempPath);
            double downloadedMB = partialFile.Length / 1024.0 / 1024.0;

            Status =
              "Downloading model...\n" +
              "Downloaded so far: " + Math.Round(downloadedMB, 2) + " MB";

            Component.Message = "Downloading";
            Progress = -1.0;
          }

          Rhino.RhinoApp.Wait();
          System.Threading.Thread.Sleep(300);
        }

        string output = process.StandardOutput.ReadToEnd();
        string error = process.StandardError.ReadToEnd();

        if (process.ExitCode != 0)
        {
          Status =
            "Download failed.\n" +
            "Exit code: " + process.ExitCode + "\n" +
            "Error: " + error + "\n\n" +
            "Test manually by opening Command Prompt and running:\n" +
            "curl.exe -L --http1.1 \"" + modelUrl + "\" -o \"" + tempPath + "\"";

          FilePath = null;
          Progress = 0.0;
          Component.Message = "Error";
          return;
        }
      }

      FileInfo downloadedFile = new FileInfo(tempPath);

      if (!downloadedFile.Exists || downloadedFile.Length == 0)
      {
        if (File.Exists(tempPath))
        {
          File.Delete(tempPath);
        }

        Status = "Download failed: downloaded file is empty.";
        FilePath = null;
        Progress = 0.0;
        Component.Message = "Error";
        return;
      }

      // Optional weak validation: Hugging Face error pages are usually tiny HTML files.
      // A real ONNX model should not start with '<'.
      using (FileStream fs = new FileStream(tempPath, FileMode.Open, FileAccess.Read))
      {
        if (fs.Length > 0)
        {
          int firstByte = fs.ReadByte();

          if (firstByte == 60) // '<'
          {
            fs.Close();

            if (File.Exists(tempPath))
            {
              File.Delete(tempPath);
            }

            Status =
              "Download failed: the downloaded file looks like an HTML error page, not an ONNX model.\n" +
              "Please check whether the Hugging Face file is public and accessible:\n" +
              modelUrl;

            FilePath = null;
            Progress = 0.0;
            Component.Message = "Error";
            return;
          }
        }
      }

      if (File.Exists(destinationPath))
      {
        File.Delete(destinationPath);
      }

      File.Move(tempPath, destinationPath);

      FileInfo finalFile = new FileInfo(destinationPath);

      Status =
        "Model downloaded successfully.\n" +
        "Path: " + destinationPath + "\n" +
        "Size: " + Math.Round(finalFile.Length / 1024.0 / 1024.0, 2) + " MB";

      FilePath = destinationPath;
      Progress = 100.0;
      Component.Message = "Done";
    }
    catch (Exception ex)
    {
      Status =
        "Download failed.\n" +
        "Error: " + ex.Message;

      FilePath = null;
      Progress = 0.0;
      Component.Message = "Error";
    }
  }
}
# ---------- end yel_1_0 ----------

# ---- group: GAN_with_tke_roof
path = FilePath("C:\Users\ilker\Desktop\Conditional_Transformer\Pix2PixHD_Model\pix2pixhd_uk_roof_generator.onnx")

# ---- group: FNO_ONXX file / GAN_with tke
path_2 = FilePath("C:\Users\ilker\Desktop\Conditional_Transformer\Pix2PixHD_Model\pix2pixhd_uk_generator.onnx")

# ----
panel = Panel(yel_1_0.Progress)
panel_2 = Panel("""0
0
1""")
entwine = Entwine(Branch00=brep, Branch01=brep_2, Branch02=brep_3, FlattenInputs=True)  # -> simplify(Result)

entwine_2 = Entwine(Branch00=yel_1_0.FilePath, Branch01=path_2, Branch02=path, FlattenInputs=True)  # -> simplify(Result)
branch = TreeBranch(Tree=entwine_2, Path=list_2, MaintainPaths=False)

branch_2 = TreeBranch(Tree=simplify(graft(panel_2)), Path=simplify(list_2), MaintainPaths=False)
branch_3 = TreeBranch(Tree=entwine, Path=list, MaintainPaths=True)
list_3 = ValueList({"Velocity": 0, "Turbulent Kinetic Energy": 1}, selected="Velocity")

# ---- group: Terrain- Do not change / TERRAIN
srf = Surface(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)

# ---- group: wind direction
list_4 = ValueList({"North": 0, "Northeast": 45, "East": 90, "Southeast": 135, "South": 180, "Southwest": 225, "West": 270, "Northwest": 315}, selected="North")

# ---- group: Terrain- Do not change
move = Move(Geometry=srf, Motion=Vector(0, 0, 1.8))  # -> Geometry, Transform
brep2grid = BrepToGridPoints(Geometry=move.Geometry, Spacing="2", Run=True)  # -> Points, Status

# ---- group: Buildings
brep_4 = Brep(branch_3)

# ---- group: Wind Speed
panel_3 = Panel("5")

# ---- group: Legend Settings
list_5 = ValueList({"Jet": "jet", "Turbo": "turbo", "Viridis": "viridis", "Magma": "magma", "Plasma": "plasma", "Inferno": "inferno", "Coolwarm": "coolwarm", "Pastel": "pastel", "Gray": "gray"}, selected="Coolwarm")
dom = ConstructDomain(DomainStart=0, DomainEnd=panel_3)

# ----
preview = CustomPreview(Geometry=brep_4, Material=ColourSwatch(SwatchColor=RGB(204, 204, 204)))
entwine_3 = Entwine(Branch00=dom, FlattenInputs=True)  # -> simplify(Result)
swatch = ColourSwatch(SwatchColor=RGB(255, 255, 255))
branch_4 = TreeBranch(Tree=entwine_3, Path=list_3, MaintainPaths=True)
windpredict = WindPredictor(
    Points=brep2grid.Points,
    Buildings=brep_4,
    ONNXPath=branch,
    U_ref=panel_3,
    Z_ref=10,
    Pedestrian_level=1.8,
    Wind_dir=list_4,
    GPU=True,
    FilterMargin=100,
    Palette=list_5,
    LegendDomain=branch_4,
    Interpolate=True,
    ShowTKE=list_3,
    ShowRoof=branch_2)  # -> X, Y, WindSpeed, GridMesh, LegendMesh, LegendPoints, LegendValues, TurbulentKineticEnergy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
compass = WindCompass(DirectionIndex=list_4, Radius=420, BasePoint=Point(0, 0, 0), Color=swatch, ArrowScale=0.5)  # -> Circle, Arrow
entwine_4 = Entwine(Branch00=windpredict.WindSpeed, Branch01=windpredict.TurbulentKineticEnergy, FlattenInputs=True)  # -> simplify(Result)
mesh = Mesh(windpredict.GridMesh)
mesh_2 = Mesh(windpredict.LegendMesh)
tag = TextTag3D(Location=windpredict.LegendPoints, Text=windpredict.LegendValues, Size=14, Colour=swatch, Justification=5)
area = Area(Geometry=mesh_2)  # -> Area, Centroid
branch_5 = TreeBranch(Tree=entwine_4, Path=list_3, MaintainPaths=True)
bnd = Bounds(Numbers=branch_5)

# ---- group: Wind speed range
panel_4 = Panel(bnd)

# ----
Y = UnitY(Factor=-100)
Y_2 = UnitY(Factor=-50)
move_2 = Move(Geometry=area.Centroid, Motion=Y)  # -> Geometry, Transform
move_3 = Move(Geometry=move_2.Geometry, Motion=Y_2)  # -> Geometry, Transform
concat = Concatenate(
    FragmentA="Incoming wind direction & speed: ",
    FragmentB=compass.Arrow,
    FragmentC=", ",
    FragmentD=panel_3,
    FragmentE=" m/s")
concat_2 = Concatenate(FragmentA="Min - Max: ", FragmentB=panel_4)
tag_2 = TextTag3D(Location=move_2.Geometry, Text=concat_2, Size=16, Colour=swatch, Justification=5)
tag_3 = TextTag3D(Location=move_3.Geometry, Text=concat, Size=16, Colour=swatch, Justification=5)
