# Grasshopper definition 9_ML_Inference_Comfort.ghx (Grasshopper 1.0.8)
# plug-ins: Eddy3D

# How to?
# 
# -Please downlaod the ML models first (GAN and FNO).
#  Then assign them in the "File Path" components, respectively.
# 
# -Connect your input geometry to "Builidngs"
# 
# -Define wind speed/direction (optional).
# 
# -Define wind comfort map (optional).
select = SelectTemplate()

# ---- group: GAN_tke_roof / model selection
list = ValueList({"GAN": 0, "GAN_tke": 1, "GAN_tke_roof": 2}, selected="GAN_tke_roof")

# ---- group: GAN_tke_roof / FNO_ONXX file / GAN_with TKE
path = FilePath("C:\Users\ilker\Desktop\Conditional_Transformer\Pix2PixHD_Model\pix2pixhd_uk_generator.onnx")

# ---- group: GAN_tke_roof / GAN
path_2 = FilePath("C:\Users\ilker\Desktop\Conditional_Transformer\Pix2PixHD_Model\pix2pixhd_generator.onnx")

# ---- group: GAN_tke_roof
G = FilePath("C:\Users\ilker\Desktop\Conditional_Transformer\Pix2PixHD_Model\pix2pixhd_uk_roof_generator.onnx")

# ----
panel = Panel("""0
0
1""")
branch = TreeBranch(Tree=simplify(graft(panel)), Path=list, MaintainPaths=True)

# ---- group: GAN_tke_roof
entwine = Entwine(Branch00=path_2, Branch01=path, Branch02=G, FlattenInputs=True)  # -> simplify(Result)
branch_2 = TreeBranch(Tree=entwine, Path=list, MaintainPaths=False)

# ---- group: Terrain- Do not change / TERRAIN
srf = Surface(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)

# ----
list_2 = ValueList({"Wind Comfort Study - 8 wind directions": 0, "Wind Comfort Study - 16 wind directions": 1}, selected="Wind Comfort Study - 16 wind directions")

# ---- group: Terrain- Do not change
move = Move(Geometry=srf, Motion=Vector(0, 0, 1.8))  # -> Geometry, Transform
brep2grid = BrepToGridPoints(Geometry=move.Geometry, Spacing="2", Run=True)  # -> Points, Status

# ---- group: Buildings
brep = Brep([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])

# ----
range = Range(Domain="0 To 315", Steps=7)
range_2 = Range(Domain="0 To 337.5", Steps=15)
preview = CustomPreview(Geometry=brep, Material=ColourSwatch(SwatchColor=RGB(204, 204, 204)))
entwine_2 = Entwine(Branch00=range, Branch01=range_2, FlattenInputs=True)  # -> simplify(Result)
branch_3 = TreeBranch(Tree=entwine_2, Path=list_2, MaintainPaths=False)
windpredict = WindPredictor(
    Points=brep2grid.Points,
    Buildings=brep,
    ONNXPath=branch_2,
    U_ref="5",
    Z_ref=10,
    Pedestrian_level=1.8,
    Wind_dir=branch_3,
    GPU=True,
    FilterMargin=100,
    Palette="jet",
    Interpolate=True,
    ShowTKE=False,
    ShowRoof=branch)  # -> X, Y, WindSpeed, GridMesh, LegendMesh, LegendPoints, LegendValues, TurbulentKineticEnergy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
comfort_metric = ValueList({"NEN8100 Comfort": 4, "NEN8100 Safety": 5, "Lawson General": 0, "Lawson LDDC": 1, "Lawson 2001": 2, "Davenport": 3}, selected="NEN8100 Comfort")
pt = ConstructPoint(XCoordinate=windpredict.X, YCoordinate=windpredict.Y, ZCoordinate=1.8)

# ---- group: Weather file as *.epw
path_3 = FilePath("C:\Users\ilker\Desktop\wind_study\epw_files\TUR_Istanbul.170600_IWEC.epw")

# ----
windcomfortml = WindComfortPredictorML(
    Points=pt,
    WindSpeeds=windpredict.WindSpeed,
    EPWPath=path_3,
    Z_ref=10,
    Z_0=1,
    Metric=comfort_metric,
    Interpolate=True,
    FastModeMoM=True,
    BoundaryConditions=windpredict.BoundaryConditions,
    TKE=windpredict.TurbulentKineticEnergy,
    WindSpeedsRoof=windpredict.WindSpeedRoof,
    TKERoof=windpredict.TurbulentKineticEnergyRoof,
    Buildings=brep)  # -> ComfortRank, ClassLetter, Class, ComfortMesh, LegendMesh, LegendPoints, LegendLetters, MetricName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
swatch = ColourSwatch(SwatchColor=RGB(255, 255, 255))
mesh = Mesh(windcomfortml.ComfortMesh)
mesh_2 = Mesh(windcomfortml.LegendMesh)
tag = TextTag3D(Location=windcomfortml.LegendPoints, Text=windcomfortml.CategoryExplanations, Size=11, Colour=swatch, Justification=8)
area = Area(Geometry=mesh_2)  # -> Area, Centroid
move_2 = Move(Geometry=area.Centroid, Motion=Vector(0, 50, 0))  # -> Geometry, Transform
tag_2 = TextTag3D(Location=move_2.Geometry, Text=windcomfortml.MetricName, Size=14, Colour=swatch, Justification=8)
