# Grasshopper definition PALM_4U.ghx (Grasshopper 1.0.8)
# plug-ins: Eddy3D-PALM

palm_sample_buildings = ImportedSTL([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])
palm_sample_trees = ImportedSTL([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])
mjoin = MeshJoin(Meshes=palm_sample_buildings)
mjoin_2 = MeshJoin(Meshes=palm_sample_trees)
mjoin_3 = MeshJoin()
# PALM-4U — urban microclimate (skeleton)
# 
# 1  Define the grid over your site (lower-left corner at the Rhino origin, y = north).
# 2  Wire terrain, buildings and tree crowns into PALM Static Driver, toggle Write.
# 3  Set wind + duration in PALM Settings, then toggle Run.
# 4  Watch PALM Progress; read PET/UTCI maps in PALM Results.
# 
# Needs the PALM container image — Eddy3D Setup → Urban microclimate (PALM-4U).
palm_domain = PALMDomain(Latitude=52.5, Longitude=13.4, CellSize=2, CellsX=64, CellsY=64, CellsZ=48, Origin=Point(0, 0, 0))  # -> Domain, Boundary, Summary
# Optional: PALM Land Cover fetches OSM
# vegetation / water / pavement for the window.
# Urban block polygons are skipped — paint those
# by hand.
palm_land_cover = PALMLandCover(Domain=palm_domain.Domain, Fetch=False)  # -> LandCover, Outlines, Report
palm_settings = PALMSettings(
    Duration=2,
    Spinup=0.5,
    OutputInterval=10,
    WindSpeed=3,
    WindDirection=270,
    AirTemperature=20,
    Humidity=0.008,
    DateTime="2023-06-21 12:00:00 +00",
    SliceHeight=2,
    Comfort=True)  # -> Settings, Summary
palm_static = PALMStaticDriver(
    Domain=palm_domain.Domain,
    Buildings=palm_sample_buildings,
    Trees=palm_sample_trees,
    LandCover=palm_land_cover.LandCover,
    BuildingType=" after 2000",
    VegetationType="3 — Short grass",
    PavementType="1 — Asphalt / concrete mix",
    WaterType="1 — Lake",
    GroundCover="3 — Short grass",
    SoilType="3 — Medium-fine",
    LeafAreaDensity=2,
    Write=False)  # -> Driver, Path, Report
palm_run = PALMRun(
    Driver=palm_static.Driver,
    Settings=palm_settings.Settings,
    Engine="Container (Docker/Podman)",
    Image="Auto (published image for this machine)",
    Cores=4,
    Clear=False,
    Run=False)  # -> Namelist, Script, Command, Status, CaseFolder
palm_results = PALMResults(CaseFolder=palm_run.CaseFolder, File="Averaged XY (…_av_xy)", Frame=-1, Domain=palm_domain.Domain)  # -> Mesh, Values, Variables, Times, Info
palm_progress = PALMProgress(CaseFolder=palm_run.CaseFolder, Live=True)  # -> Progress, SimulatedTime, Done, Status
