# Grasshopper definition Sunpath.ghx (Grasshopper 1.0.8)
# plug-ins: Outdoor, Eddy3D, Eddy3D-Radiance

weather = DownloadWeather(Station="Istanbul")  # -> EPWFile, Logs, Stations, Station, ExtraFiles, SiteLatitude, SiteLongitude
weather_2 = Weather(EPWFilePath=weather.EPWFile)
sunpath = SunPath(Weather=weather_2, Latitude=0, Longitude=0, TimeZone=0, Center=Point(0, 0, 0), Radius=100, North=0)  # -> Arcs, Analemmas, Suns, Compass, Report
