# Grasshopper definition FluidX3D.ghx (Grasshopper 1.0.8)
# plug-ins: Eddy3D-LBM, Outdoor, Eddy3D-FluidX3D

# Description: GPU wind simulation around buildings, watched live in the viewport, on the FluidX3D lattice-Boltzmann engine. An Atmospheric Boundary Layer at its defaults (5 m/s at 10 m, z0 1 m) and the Geometry buildings feed LBM Case, with FluidX3D Run Settings fixing a 2 m grid and 720 s of simulated time; LBM Run launches the solver. A domain face is raised one unit and quad-remeshed to about 10,000 quads; its vertices are probed for the Scalar and Vector Field Viewers while FluidX3D Live View colours the mesh. Eddy3D builds FluidX3D locally; its licence excludes commercial use. Set your Geometry.
atmospheric_boundary_layer = AtmosphericBoundaryLayer(
    ReferenceHeight=10,
    RoughnessLengthZ0=1,
    GroundHeight=0,
    TurbulentKEK=0.015,
    TurbulentEpsilonΕ=0.135,
    TurbulentOmegaΩ=100,
    TerrainType="Custom (z0 input)",
    AblOutputLayoutVersion=2)  # -> BoundaryConditions, WindVectors
fluidx3d_run_settings = FluidX3DRunSettings(
    Memory=0,
    SimTime="720",
    ExportInterval=10,
    GroundZ=0,
    Interactive=False,
    GridSpacing="2",
    FluidX3DRunSettingsInputLayoutVersion=2)
geometry = Geometry([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])
panel = Panel(fluidx3d_run_settings)
lbm_case = LBMCase(
    CaseName="Case",
    ABL=atmospheric_boundary_layer.BoundaryConditions,
    Buildings=geometry,
    Settings=fluidx3d_run_settings,
    Write=False,
    Clear=False)  # -> Logs, Case, Domain, Folder
unit_z = UnitZ(Factor=1)
lbm_run = LBMRun(Case=lbm_case.Case, Run=False, LbmInputLayoutVersion=7)  # -> Logs, Case, Domain, Folder
quad_remesh_settings = QuadRemeshSettings(
    TargetCount=Slider(10000, range=0..10000),
    AdaptiveSize=0,
    AdaptiveCount=False,
    HardEdges=False,
    SeamEdges=0,
    Symmetry=0,
    GuideCurves=0)
deconstruct_brep = DeconstructBrep(Brep=lbm_run.Domain)  # -> Faces, Edges, Vertices
list_item = ListItem(List=deconstruct_brep.Faces, Index=Slider(4, range=0..10), Wrap=True)
move = Move(Geometry=list_item, Motion=unit_z)  # -> Geometry, Transform
quad_remesh = QuadRemesh(Geometry=move.Geometry, Settings=quad_remesh_settings)
deconstruct_mesh = DeconstructMesh(Mesh=quad_remesh)  # -> Vertices, Faces, Colours, Normals
fluidx3d_live_view = FluidX3DLiveView(Case=lbm_run.Case, Mesh=quad_remesh, Live=False, MaxSpeed=0, AvgWindow=360)  # -> Mesh, Speeds, Time, Status
probe = Probe(
    Case=lbm_run.Case,
    Points=deconstruct_mesh.Vertices,
    Run=True,
    BakeTimeHistory=False,
    CullHugeVectors=True,
    CullInvalid=True,
    ShowRegion=False)  # -> Values, TimeSteps, SubResults
mesh = Mesh(fluidx3d_live_view.Mesh)
vector_field_viewer = VectorFieldViewer(
    Points=deconstruct_mesh.Vertices,
    Velocity=probe.Values,
    DisplayMode="Vector Field",
    Scale=1,
    ColorMap="Viridis",
    SeedCount=120,
    ArrowheadScaling="Linear",
    VectorPlane="3D")  # -> Geometry, Colors, Range
scalar_field_viewer = ScalarFieldViewer(
    Points=deconstruct_mesh.Vertices,
    Values=probe.Values,
    DisplayMode="Heatmap Mesh",
    Mesh=quad_remesh,
    PointSize=4,
    ColorMap="Viridis")  # -> Geometry, Colors, Range
