# Grasshopper definition ML_Inference_Comfort.ghx (Grasshopper 1.0.8)
# plug-ins: Outdoor, Eddy3D

# Description: Classifies year-round pedestrian wind comfort from machine-learning wind fields, with no CFD run. Wind Predictor runs Yel 2.0 for 16 directions (0 to 337.5 degrees, 5 m/s) on a 2 m grid 1.8 m above the terrain. Wind Comfort Predictor (ML) merges these with the hourly EPW from Download Weather (Istanbul), fits Weibull statistics per point and applies Lawson General, or another Lawson, Davenport or NEN 8100 metric; where the model supplies roof speeds, roofs are classified too. Outputs: class-colored comfort mesh and legend. Swap buildings (three samples), station and metric. Screening only; confirm important results with a Wind Study.
select = SelectTemplate()

# ---- group: Terrain- Do not change, try to center your geometry accordingly. / TERRAIN
srf = Surface(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)

# ----
token = FilePath("D:\GithubProjects\Conditional_Transformer\TokenHF\HF_Token.txt")
mlmodel = MLModel(Model="Yel 2.0", HFToken=token, Run=Toggle(True), MLModelInputLayoutVersion=2)  # -> Status, FilePath, Progress

# ---- group: Terrain- Do not change, try to center your geometry accordingly.
move = Move(Geometry=srf, Motion=Vector(0, 0, 1.8))  # -> Geometry, Transform
brep2grid = BrepToGridPoints(Geometry=move.Geometry, Spacing="2")  # -> Points, Vectors, Mesh, Status

# ---- group: Wind Speed
panel = Panel("5")

# ----
range = Range(Domain=Domain(0, 337.5), Steps=15)
abl = ABLFlow(
    WindDirections=range,
    WindSpeed=panel,
    ReferenceHeight=10,
    RoughnessLengthZ0=1,
    GroundHeight=0,
    TurbulentKEK=0.015,
    TurbulentEpsilonΕ=0.135,
    TurbulentOmegaΩ=100,
    TerrainType="Custom (z0 input)",
    AblOutputLayoutVersion=2)  # -> BoundaryConditions, WindVectors

comfort_metric = ValueList({"NEN8100 Comfort": 4, "NEN8100 Safety": 5, "Lawson General": 0, "Lawson LDDC": 1, "Lawson 2001": 2, "Davenport": 3}, selected="Lawson General")
weather = DownloadWeather(Station="istanbul")  # -> EPWFile, Logs, Stations, Station, ExtraFiles, SiteLatitude, SiteLongitude

# ---- group: Geometry Input
list = ValueList({"Architectural Insitute of Japan - Case E": 0, "OpenFOAM - Wind Around Buildings": 1, "Eddy3D Validation Sample": 2}, selected="Architectural Insitute of Japan - Case E")
brep = Brep([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])
brep_2 = Brep([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])
brep_3 = Brep([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])
entwine = Entwine(Branch00=brep, Branch01=brep_2, Branch02=brep_3, FlattenInputs=True)  # -> simplify(Result)
branch = TreeBranch(Tree=entwine, Path=list, MaintainPaths=True)

# ---- group: Geometry Input / Buildings
brep_4 = Brep(branch)

# ---- group: Geometry Input (continued)
preview = CustomPreview(Geometry=brep_4, Material=ColourSwatch(SwatchColor=RGB(204, 204, 204)))

# ----
windpredict = WindPredictor(
    Points=brep2grid.Points,
    Buildings=brep_4,
    Model=mlmodel.FilePath,
    BoundaryConditions=abl.BoundaryConditions,
    PedestrianLevel=1.8,
    FilterMargin=0,
    Palette="jet",
    Interpolate="Smooth",
    Field="Velocity",
    Level="Roof Level",
    Radius=0.75,
    LegendScale=1,
    MeshType="Square",
    Run=True)  # -> X, Y, Values, GridMesh, LegendMesh, LegendPoints, LegendValues, BoundaryConditions, ValuesRoof
pt = ConstructPoint(XCoordinate=windpredict.X, YCoordinate=windpredict.Y, ZCoordinate=1.8)

windcomfortml = WindComfortPredictorML(
    Points=pt,
    WindSpeeds=windpredict.Values,
    EPWPath=weather.EPWFile,
    ReferenceHeight=10,
    RoughnessLengthZ0=1,
    Metric=comfort_metric,
    Interpolate="True",
    FastModeMoM="True",
    BoundaryConditions=windpredict.BoundaryConditions,
    WindSpeedsRoof=windpredict.ValuesRoof,
    Buildings=brep_4)  # -> ComfortRank, ClassLetter, Class, ComfortMesh, LegendMesh, LegendPoints, LegendLetters, MetricName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
swatch = ColourSwatch(SwatchColor=RGB(0, 0, 0))
mesh = Mesh(windcomfortml.ComfortMesh)
mesh_2 = Mesh(windcomfortml.LegendMesh)
tag = TextTag3D(Location=windcomfortml.LegendPoints, Text=windcomfortml.CategoryExplanations, Size=11, Colour=swatch, Justification=8)
area = Area(Geometry=mesh_2)  # -> Area, Centroid
move_2 = Move(Geometry=area.Centroid, Motion=Vector(0, 50, 0))  # -> Geometry, Transform
tag_2 = TextTag3D(Location=move_2.Geometry, Text=windcomfortml.MetricName, Size=14, Colour=swatch, Justification=8)
