# Grasshopper definition Solar_Access.ghx (Grasshopper 1.0.8)
# plug-ins: Outdoor, Eddy3D, Eddy3D-Radiance

# Description: A tiny solar-access scene: a 0.5 m square, 10 m tall box at the corner of a 5 x 5 m ground plane, with Ithaca weather from Download Weather and Weather. Facade Grid lays 1 m cells on the plane, with normals and areas. Sun Hours covers a single day (1 July, hours 4344 to 4368), which Sun Stats at a 2 h threshold and Sunlight Compliance for BRE amenity overshadowing then evaluate. Shadow with Deconstruct Shadow and Solar Irradiation cover every daylight hour of the year. Replace the Box 2Pt context, the plane and the station with your site.
panel = Panel("0")
dom = ConstructDomain(DomainStart=panel, DomainEnd="5")
pt = ConstructPoint(XCoordinate=-0.25, YCoordinate=-0.25, ZCoordinate=0)
pt_2 = ConstructPoint(XCoordinate=0.25, YCoordinate=0.25, ZCoordinate=10)
weather = DownloadWeather(Station="Ithaca")  # -> EPWFile, Logs, Stations, Station, ExtraFiles, SiteLatitude, SiteLongitude
box = Box2Pt(PointA=pt, PointB=pt_2, Plane=PlaneXY(0, 0, 0))
planesrf = PlaneSurface(Plane=PlaneXY(0, 0, 0), XSize=dom, YSize=dom)
weather_2 = Weather(EPWFilePath=weather.EPWFile)
facgrid = FacadeGrid(Geometry=planesrf, Spacing=1, Offset=0.05, MaxTilt=90, Flip=False)  # -> Points, Normals, Areas, Grid, Report
sunhrs = SunHours(
    Context=box,
    Points=facgrid.Points,
    Normals=facgrid.Normals,
    Weather=weather_2,
    StartHour=4344,
    EndHour=4368,
    Timestep=1,
    North=0,
    Offset=0.01,
    SunHoursInputLayoutVersion=2)  # -> SunHours, Fraction, Colors, Report
shadow = Shadow(
    Context=box,
    Points=facgrid.Points,
    Normals=facgrid.Normals,
    Weather=weather_2,
    Offset=0.01,
    North=0,
    ShadowInputLayoutVersion=2)  # -> Lit, Colors, SunlitPoints, Report, Result
solarirr = SolarIrradiation(
    Context=box,
    Points=facgrid.Points,
    Normals=facgrid.Normals,
    Weather=weather_2,
    Timestep=1,
    GroundReflectance=0.2,
    Offset=0.01,
    North=0,
    SolarIrradiationInputLayoutVersion=2)  # -> Total, Direct, Diffuse, Reflected, Colors, Report
deconstruct_shadow = DeconstructShadow(Result=shadow.Result)  # -> Points, LitFraction, SunHours, Colors, Lit, SunlitPoints, Instants
suncomply = SunlightCompliance(
    Standard=0,
    SunHours=sunhrs.SunHours,
    Areas=facgrid.Areas,
    AvailableHours=0,
    AvailableWinterHours=0,
    AmenityHours=2,
    AmenityAreaFraction=0.5,
    APSHAnnualFraction=0.25,
    APSHWinterFraction=0.05)  # -> Passes, Value, Threshold, PointPasses, Report
sunstats = SunStats(Values=sunhrs.SunHours, Grid=facgrid.Grid, Areas=facgrid.Areas, Threshold=2)  # -> Min, Mean, Median, Max, AreaAbove, FractionAbove, Report
