# Grasshopper definition SurfaceTemps_FFT.ghx (Grasshopper 1.0.8)
# plug-ins: Outdoor, Eddy3D, Eddy3D-Radiance

site_picker = SitePicker(
    SitePickerAddress="36, East 14th Street, Union Square, Manhattan Community Board 5, Manhattan, New York County, New York, 10003, United States",
    SitePickerLat=40.735204,
    SitePickerLon=-73.991737)  # -> Latitude, Longitude, Address
select_template = SelectTemplate()
boolean_toggle = BooleanToggle(True)
lidar_site = LiDARSite(
    Latitude=site_picker.Latitude,
    Longitude=site_picker.Longitude,
    Size="100",
    Source="Auto",
    Roads=True,
    Run=boolean_toggle,
    LidarSiteInputLayoutVersion=4)  # -> PointCloud, Footprints, Domain, Frame, Report, TreeCrowns, LayerOutlines, LayerNames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
weather = DownloadWeather(Station="New York", ChartMonthFrom=1, ChartMonthTo=12)  # -> EPWFile, Logs, Stations, Station, ExtraFiles, SiteLatitude, SiteLongitude
city_surface = CitySurface(
    PointCloud=lidar_site.PointCloud,
    Footprints=lidar_site.Footprints,
    Domain=lidar_site.Domain,
    CloudOffset=Vector(0, 0, 0),
    LayerOutlines=lidar_site.LayerOutlines,
    LayerNames=lidar_site.LayerNames,
    Flatten=lidar_site.Flatten,
    LayerRoughness=lidar_site.LayerRoughness,
    LayerPercentile=0.5,
    RoofPercentile=0.9,
    GroundSpacing="5",
    Smoothing=2,
    LoD="LoD 2.2",
    Buffer=0,
    RoofHints=lidar_site.RoofHints,
    Engine="GPU",
    Run=boolean_toggle,
    CitySurfaceInputLayoutVersion=8,
    ClayLook=True)  # -> Terrain, Buildings, Layers, LayerNames, Surface, RoofHeights, Report, LayerRoughness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
number_slider = Slider(3, range=0..10)
brepgrid = BrepGridPoints(Geometry=city_surface.Terrain, Spacing=number_slider)  # -> Points, Vectors, Mesh, Status
brepgrid_2 = BrepGridPoints(Geometry=city_surface.Buildings, Spacing=number_slider)  # -> Points, Vectors, Mesh, Status
sky_exposure = SkyExposure(Positions=brepgrid.Points, Context=city_surface.Buildings, Offset=0.918, Engine="Auto")
surfacetemp_material = SurfaceTempMaterial(MaterialList="grass_ground")
surfacetemp_material_2 = SurfaceTempMaterial(MaterialList="brick_wall")
surfacetemp = SurfaceTemp(
    Points=brepgrid.Points,
    Vectors=brepgrid.Vectors,
    EPW=weather.EPWFile,
    Material=surfacetemp_material,
    IndoorTemp=22,
    SkyView=sky_exposure,
    Compute="Auto",
    Run=True,
    SurfaceTempInputLayoutVersion=2,
    SurfaceTempPersistResults=False)
surfacetemp_2 = SurfaceTemp(
    Points=brepgrid_2.Points,
    Vectors=brepgrid_2.Vectors,
    EPW=weather.EPWFile,
    Material=surfacetemp_material_2,
    IndoorTemp=22,
    SkyView=sky_exposure,
    Compute="Auto",
    Run=True,
    SurfaceTempInputLayoutVersion=2,
    SurfaceTempPersistResults=False)
deconstruct_surfacetemp = DeconstructSurfaceTemp(Result=surfacetemp)  # -> Mean, Min, Max, SurfaceTemp
deconstruct_surfacetemp_2 = DeconstructSurfaceTemp(Result=surfacetemp_2)  # -> Mean, Min, Max, SurfaceTemp
mesh_join = MeshJoin(Meshes=[brepgrid_2.Mesh, brepgrid.Mesh])
merge = Merge(Data1=brepgrid.Points, Data2=brepgrid_2.Points)  # -> flatten(Result)
merge_2 = Merge(Data1=deconstruct_surfacetemp.Mean, Data2=deconstruct_surfacetemp_2.Mean)  # -> flatten(Result)
scalar_field_viewer = ScalarFieldViewer(Points=merge, Values=merge_2, DisplayMode="Heatmap Mesh", Mesh=mesh_join, Size=4, ColorMap="Turbo", Fit="Gapless")  # -> Geometry, Colors, Range
flex_legend = FlexLegend(
    Values=merge_2,
    Points=merge,
    MetricType="sun hours",
    ColorMap="Inferno",
    Contours="Off",
    Plane=PlaneXY(0, 0, 0),
    LabelStyle="Text",
    Offset=0.5,
    Smoothing=0,
    Aggregate="Mean",
    HighlightTop=0,
    FlexLegendInputLayoutVersion=4)  # -> LegendMesh, LegendPoints, LegendValues, FieldMesh, Colors, ResolvedRange, Contours, ContourValues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
