# Grasshopper definition BoxDomain.ghx (Grasshopper 1.0.8)
# plug-ins: Outdoor

box_domain = BoxDomain(
    CellSize="100",
    FrontExtension=-1,
    BackExtension=-1,
    SideExtension=-1,
    TopExtension=-1,
    RefinementBoxExtension=-1,
    WakeRefinement=3)
atmospheric_boundary_layer = AtmosphericBoundaryLayer(
    ReferenceHeight=10,
    RoughnessLengthZ0=1,
    GroundHeight=0,
    TurbulentKEK=0.015,
    TurbulentEpsilonΕ=0.135,
    TurbulentOmegaΩ=100)  # -> BoundaryConditions, WindVectors, AirABLSettings
mesh_settings = MeshSettings(
    RefinementBoxLevel=2,
    BuildingSurfaceLevel=2,
    BuildingFeatureLevel=2,
    GroundSurfaceLevel=3,
    LayerCount=4,
    AddLayers=False,
    Snap=True,
    GradingStrengthHorizontal="25",
    GradingStrengthVertical="25",
    AdaptiveGrading=True)
run_settings = RunSettings(
    Iterations=1000,
    WriteInterval=20,
    KeepTimeSteps=3,
    TurbulenceModel="realizableKE",
    CPUCount=-1,
    SolverAlgorithm="SIMPLE",
    AgeOfAir=False,
    Robustness="4",
    PotentialFoamInit=True,
    WarmUpIterations=-1,
    FieldMonitors=False,
    PedestrianAverage=False,
    Convergence_2=0.0001,
    AutoStopOnPlateau=False)  # -> RunSettings, DebugLogs

# ---- group: Tree
geometry = Geometry(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)
tree = Tree(Geometry=geometry)

# ---- group: Buildings
geometry_2 = Geometry([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])

# ----
preview = CustomPreview(Geometry=geometry_2, Material=ColourSwatch(SwatchColor=RGB(212, 212, 212)))
outdoor_case = OutdoorCase(
    CaseName="box_case",
    BoundaryConditions=atmospheric_boundary_layer.BoundaryConditions,
    DomainParameters=box_domain,
    Buildings=geometry_2,
    Trees=tree,
    MeshSettings=mesh_settings,
    RunSettings=run_settings.RunSettings,
    Write=Button(),
    ClearCase=Button(),
    AutoName="merry-lemur-dune-quill",
    OutdoorCaseInputLayoutVersion=2,
    PreviewBuildings=False,
    PreviewDimensions=True,
    PreviewGrid3D=False,
    PreviewGroundGrid=True,
    PreviewRefinementBox=True,
    PreviewWindArrows=True)  # -> Logs, WriteLogs, Case, Domain, RefinementBox, Buildings
live_residuals = LiveResiduals(Case=outdoor_case.Case, Live=True, DirectionDegrees=-1)
open_in_paraview = OpenInParaView(Case=outdoor_case.Case, Open=False, ComfortMetric=1, DirectionIndex=-1)
meshing_progress = MeshingProgress(Case=outdoor_case.Case, Live=True)  # -> Progress, Phase, Done, Status
plot_residuals = PlotResiduals(Case=outdoor_case.Case, Plot=False, ResidualViewerTarget=0)
run = Run(
    Case=outdoor_case.Case,
    Mesh=Button(),
    CreateZones=Button(),
    Simulate=Button(),
    RunAll=False,
    Parallel=True,
    DirectionIndex=-1,
    ShowZones=True)

geometry_3 = Geometry([Point(-80.2763443, -188.6662445, 0), Point(-80.2763443, -185.6625214, 0), Point(-80.2763443, -182.6588135, 0), Point(-80.2763443, -179.6550903, 0), Point(-80.2763443, -176.6513672, 0), Point(-80.2763443, -173.6476593, 0)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])
probe = Probe(
    Case=outdoor_case.Case,
    Points=geometry_3,
    Field="U",
    Run=False,
    AutoProbeName="polite-octopus-glade-needle",
    BakeTimeHistory=False,
    CullHugeVectors=True,
    CullInvalid=True,
    ShowRegion=False)  # -> Values, TimeSteps, SubResults
vectors = Data(probe.Values)
cluster = Cluster(data=vectors)  # -> S, E, data_3
gradient = Gradient(
    LowerLimit=cluster.S,
    UpperLimit=cluster.E,
    Parameter=cluster.data_3,
    stops=[0.103: RGB(0, 0, 255), 0.22: RGB(0, 170, 255), 0.305: RGB(0, 255, 255), 0.398: RGB(0, 255, 188), 0.504: RGB(0, 255, 106), 0.605: RGB(91, 255, 0), 0.699: RGB(184, 255, 0), 0.799: RGB(255, 255, 0), 0.898: RGB(255, 170, 0)])
vdisex = VectorDisplayEx(Point=geometry_3, Vector=vectors, Colour=gradient, Width=Slider(3, range=0..10))

# ==== cluster Cluster
data = ClusterInput()
data_2 = Data(data)
data_3 = ClusterOutput(data_2)
bnd = Bounds(Numbers=data_2)
dedomain = DeconstructDomain(Domain=bnd)  # -> Start, End
S = ClusterOutput(dedomain.Start)
E = ClusterOutput(dedomain.End)
