# Grasshopper definition Pollutant_Canyon.ghx (Grasshopper 1.0.8)
# plug-ins: Outdoor, Eddy3D

pt = ConstructPoint(XCoordinate=40, YCoordinate=30, ZCoordinate=0)
pt_2 = ConstructPoint(XCoordinate=80, YCoordinate=50, ZCoordinate=20)
pt_3 = ConstructPoint(XCoordinate=40, YCoordinate=70, ZCoordinate=0)
pt_4 = ConstructPoint(XCoordinate=80, YCoordinate=90, ZCoordinate=20)
pt_5 = ConstructPoint(XCoordinate=40, YCoordinate=52, ZCoordinate=0)
pt_6 = ConstructPoint(XCoordinate=55, YCoordinate=68, ZCoordinate=10)
# Description: Purpose: Where a street-level emission goes, and how much reaches pedestrians.
# Fidelity: Engineering - steady RANS with a passive tracer, not validated for this canyon.
# Method: Two 40 x 20 x 20 m blocks form a canyon; Pollutant Source releases 0.01 kg/s of exhaust from a volume inside it.
# Result: Tracer concentration in kg/m3 at three points 2 m above ground along the canyon centreline.
# Needs: Eddy3D Setup > (U)RANS CFD (OpenFOAM). Runtime: minutes.
# Edit: Blocks, source volume and rate, probe points; turn the toggles on.
select_template = SelectTemplate()
box_domain = BoxDomain(
    CellSize="25",
    FrontExtension=-1,
    BackExtension=-1,
    SideExtension=-1,
    TopExtension=-1,
    RefinementBoxExtension=-1,
    WakeRefinement=3)
mesh_settings = MeshSettings(
    RefinementBoxLevel=2,
    BuildingSurfaceLevel=2,
    BuildingFeatureLevel=2,
    GroundSurfaceLevel=3,
    LayerCount=4,
    AddLayers=False,
    Snap=True,
    GradingStrengthHorizontal="25",
    GradingStrengthVertical="25",
    AdaptiveGrading=True,
    CellsBetweenLevels=-1)
atmospheric_boundary_layer = AtmosphericBoundaryLayer(
    ReferenceHeight=10,
    RoughnessLengthZ0=1,
    GroundHeight=0,
    TurbulentKEK=0.015,
    TurbulentEpsilonΕ=0.135,
    TurbulentOmegaΩ=100,
    TerrainType="Custom (z0 input)",
    InletProfile="Log law (Richards & Hoxey)",
    DisplacementHeight=0,
    AblOutputLayoutVersion=2)  # -> BoundaryConditions, WindVectors
box = Box2Pt(PointA=pt, PointB=pt_2, Plane=PlaneXY(0, 0, 0))
box_2 = Box2Pt(PointA=pt_3, PointB=pt_4, Plane=PlaneXY(0, 0, 0))
box_3 = Box2Pt(PointA=pt_5, PointB=pt_6, Plane=PlaneXY(0, 0, 0))
run_settings = RunSettings(
    Iterations="1000",
    WriteInterval=20,
    KeepTimeSteps=3,
    TurbulenceModel="realizableKE",
    CPUCount="10",
    SolverAlgorithm="SIMPLE",
    AgeOfAir=False,
    Numerics="0,0.5,0.5",
    PotentialFoamInit=True,
    WarmUpIterations=-1,
    FieldMonitors=False,
    PedestrianAverage=False,
    PressureCoefficient=False,
    Convergence=0.0001,
    AutoStopOnPlateau=False,
    Duration=-1,
    TimeStep=-1,
    MaxCourant=-1,
    AveragingWindow=-1,
    PressureSolver="GAMG",
    LaplacianScheme="auto",
    MeshQualityPreset="auto",
    PedestrianHeight=1.75,
    Guideline="None",
    ConcurrentDirections=1,
    EmptyDomainCheck=False)  # -> RunSettings, DebugLogs
merge = Merge(Data1=box, Data2=box_2)
pollutant = PollutantSource(Geometry=box_3, Species="exhaust", Rate=0.01, Schmidt=0.7)
outdoor_case = OutdoorCase(
    CaseName="PollutantCanyon",
    BoundaryConditions=atmospheric_boundary_layer.BoundaryConditions,
    DomainParameters=box_domain,
    Buildings=merge,
    MeshSettings=mesh_settings,
    RunSettings=run_settings.RunSettings,
    Sources=pollutant,
    PedestrianSpacing=Slider(2, range=0..10),
    Engine="Containerized",
    Write=False,
    ClearCase=False,
    AutoName="merry-lemur-dune-quill",
    AutoWrapGeometry=False,
    ClayLook=True,
    OutdoorCaseInputLayoutVersion=7,
    PreviewBuildings=False,
    PreviewDimensions=True,
    PreviewGrid3D=False,
    PreviewGroundGrid=True,
    PreviewRefinementBox=True,
    PreviewWindArrows=True,
    RepairGeometry=True)  # -> Logs, WriteLogs, Case, Domain, RefinementBox, Buildings, PedestrianPoints, Terrain
plot_residuals = PlotResiduals(Case=outdoor_case.Case, Plot=False, ResidualViewerTarget=0)
live_residuals = LiveResiduals(Case=outdoor_case.Case, Live=True, DirectionDegrees=-1, ShowResidualGoals=True)
meshing_progress = MeshingProgress(Case=outdoor_case.Case, Live=True)  # -> Progress, Phase, Done, Status
panel = Panel([meshing_progress.Progress, meshing_progress.Phase, meshing_progress.Status, meshing_progress.Done])
open_in_paraview = OpenInParaView(Case=outdoor_case.Case, Open=False, ComfortMetric=1, DirectionIndex=-1, ParaviewInputLayoutVersion=2, Streamlines=True)
run = Run(
    Case=outdoor_case.Case,
    Mesh=False,
    CreateZones=False,
    Simulate=False,
    RunAll=False,
    Parallel=True,
    DirectionIndex=-1,
    ShowZones=True)
parse_case_logs = ParseCaseLogs(Case=outdoor_case.Case, Run=False)  # -> LogSummary, Errors, Warnings
panel_2 = Panel([parse_case_logs.LogSummary, parse_case_logs.Errors, parse_case_logs.Warnings])
probe = Probe(
    Case=outdoor_case.Case,
    Points=outdoor_case.PedestrianPoints,
    Field="exhaust",
    Run=False,
    AutoProbeName="polite-octopus-glade-needle",
    BakeTimeHistory=False,
    CullHugeVectors=True,
    CullInvalid=True,
    OpenTerminal=True,
    ShowCulled=False)  # -> Values, TimeSteps, SubResults, Points
scalar_field_viewer = ScalarFieldViewer(
    Values=probe.Values,
    Points=probe.Points,
    DisplayMode="Point Cloud",
    ColorMap="Viridis",
    Size=4,
    Fit="Gapless",
    ScalarFieldViewerInputLayoutVersion=2)  # -> Geometry, Colors, Range
